# Grasshopper definition pneumeshBuilder.gh (Grasshopper 1.0.7)

jsonpath = Panel("/Users/Roll/Desktop/jointGenerator1.3/jsons/turtle")
scale = Panel("25")
spherescale = Panel("2.1")
tunnelinnerradius = Panel("0.4")
usebig = BooleanToggle(True)
generating = BooleanToggle(False)
reset = Button()
timer = Timer(TimerInterval=10000, Target=joint_generator_1)
python = GhPythonScript(x=reset)  # -> out, a
# ---------- python: Python ----------
__author__ = "Roll"

import rhinoscriptsyntax as rs
import scriptcontext as sc

sc.sticky['msg'] = ''
sc.sticky['a'] = 0
sc.doc = ghdoc
sc.sticky['iv'] = 0
# ---------- end python ----------
brep = Brep(<brep referenced from the Rhino model>)
brep_2 = Brep(<brep referenced from the Rhino model>)
radius = GhPythonScript(radiusBig="3", radiusSmall="1.601", sphereScale=spherescale, useBig=usebig, portBig=brep, portSmall=brep_2)  # -> out, radiusSphere, port; inputs portBig: list, portSmall: list
# ---------- radius: Python ----------
__author__ = "Roll"

import rhinoscriptsyntax as rs

rb = float(radiusBig)
rs = float(radiusSmall)
radiusPort = rb if useBig else rs
radiusSphere = radiusPort * 2.1

port = portBig if useBig else portSmall
# ---------- end radius ----------
python_2 = GhPythonScript(name=jsonpath, scale=scale, radiusSphere=radius.radiusSphere)  # -> out, v, curvess, prev, edges
# ---------- python_2: Python ----------
__author__ = "Roll"

import rhinoscriptsyntax as rs
import json

class Vertex:
    all = []
    def __init__(self, pos, channel):
        pos = rs.PointScale(pos, int(scale))
        self.pos = rs.CreateVector(pos)
        
        self.edges = set()
        Vertex.all.append(self)
        
        # create curves
        self.ps = [
            rs.VectorAdd(self.pos, rs.VectorScale(rs.CreateVector(p), radiusSphere * 1.01))
            for p in channel['ps']
        ]
        self.es = channel['es']
    
    def neighbor_vertices(self):
        vs = []
        for e in self.edges:
            vs.append(e.other_vertex(self))
        return vs
    
    def out_unit_vectors(self):
        # unit vectors pointing from self to neighbor vertices
        vs = self.neighbor_vertices()
        vecs = []
        for v in vs:
            vecs.append(rs.VectorUnitize(v.pos - self.pos))
        return vecs



class Edge:
    all = []
    def __init__(self, iv0, iv1):
        self.v0 = v0 = Vertex.all[iv0]
        self.v1 = v1 = Vertex.all[iv1]
        self.vs = {v0, v1}
        v0.edges.add(self)
        v1.edges.add(self)
        Edge.all.append(self)
    
    def other_vertex(self, v):
        return list(self.vs - {v})[0]

def get_curves(vs):
    curvess = []
    for v in vs:
        ps = v.ps
        es = v.es
        
        channels = []   # indices of vertices of all channels
        channel = []    # indices of vertices of each channel
        curves = []     # curves, each curve is a rhino curve
        
        e_prev = es[0]
        channel += e_prev[:]
        channels.append(channel)
        for e in es:
            if e[0] == e_prev[1]:
                channel.append(e[1])
            else:
                if e == e_prev:     ## TODO, why?
                    continue
                    #pass
                channel = e[:]
                channels.append(channel)
            e_prev = e
        
        curves = [
            [
                ps[i] 
                for i in channel
            ]
            for channel in channels
        ]
        curvess.append(curves)
    
    
    return curvess
    


with open(name+'.json') as ifile:
    content = ifile.read()
    data = json.loads(content)

v = data['v']
e = data['e']
cs = data['channel']


for i, p in enumerate(v):
    Vertex(p, cs[i])

for e in e:
    Edge(e[0], e[1])


v = Vertex.all
e = Edge.all
curvess = get_curves(v)

edges = []
for ee in Edge.all:
    p0 = ee.v0.pos
    p1 = ee.v1.pos
    edges.append(rs.AddLine(p0, p1))

#prev = v[0].ps
# ---------- end python_2 ----------
preview = CustomPreview(
    Geometry=python_2.edges,
    Material={diffuse=RGB(221, 160, 221), emission=RGB(66, 48, 66), shine=0.5, specular=RGB(255, 255, 255), transparency=0})
joint_generator_1 = GhPythonScript(
    vs=python_2.v,
    curvess=python_2.curvess,
    radiusSphere=radius.radiusSphere,
    port=radius.port,
    generate=generating,
    innerDiameter=tunnelinnerradius)  # -> out, ports, tunnels, spheres, prev; inputs vs: list, curvess: list
# ---------- joint_generator_1: Python ----------
__author__ = "Roll"

import rhinoscriptsyntax as rs
import Rhino
import random
import scriptcontext as sc


def toMesh(guid):
    return rs.JoinMeshes([m for m in Rhino.Geometry.Mesh.CreateFromBrep(rs.coercebrep(guid))])

iv = sc.sticky['iv']
if iv < len(vs) and generate:
    print('Generating joint {}.'.format(iv))
    ps = []
    tunnelss = []
    spheres = []
    joints = []
    
    i = iv
    v = vs[i]
    sc.sticky['iv'] += 1

    sphere = rs.AddSphere(v.pos, radiusSphere)
    spheres.append(sphere)
    
    vecs = v.out_unit_vectors()
    for vec in vecs:
        originalPoints = [rs.CreatePoint([0,0,0]), rs.CreatePoint([0,0,1])]
        targetPoints = [v.pos, rs.VectorAdd(v.pos, vec)]

        p = rs.CopyObject(port)
        rs.OrientObject(p, originalPoints, targetPoints)
        ps.append(p)

    tunnels = []
    for curve in curvess[i]:
        tunnel = rs.AddPipe(rs.AddCurve(curve), 0, float(innerDiameter), 0, 2)[0]
        tunnel = tunnel
        tunnels.append(tunnel)
    tunnelss.append(tunnels)
        
    tunnels = []
    for tuns in tunnelss:
        tunnels += tuns
    ports = ps
    
    prev = spheres
    for i in range(len(ports)):
        prev = rs.BooleanUnion(prev + [ports[i]], False)
   
    for i in range(len(tunnels)):
        result = rs.BooleanDifference(prev, [tunnels[i]], False)
        if result is not None and rs.coercerhinoobject(result).Geometry is None:
            result = None
        
        nTry = 0
        while result is None:
            print("Tunnel {} failed.".format(i))
            dx = random.random() * 0.03
            dy = random.random() * 0.03
            dz = random.random() * 0.03
            tunnel = rs.MoveObject(tunnels[i], (dx, dy, dz))
            result = rs.BooleanDifference(prev, [tunnel], False)
            nTry += 1
            if nTry > 10:
                print("Failed at tunnel {}.".format(i))
                break
        prev = result
    
    obj = rs.coercerhinoobject(prev)
    geometry = obj.Geometry
    attributes = obj.Attributes
    
    sc.doc = Rhino.RhinoDoc.ActiveDoc
    sc.doc.Objects.Add(geometry, attributes)
    sc.doc = ghdoc
# ---------- end joint_generator_1 ----------
panel = Panel(joint_generator_1.out)
ports = CustomPreview(
    Geometry=joint_generator_1.tunnels,
    Material={diffuse=RGB(221, 160, 221), emission=RGB(66, 48, 66), shine=0.5, specular=RGB(255, 255, 255), transparency=0})
tunnels = CustomPreview(
    Geometry=joint_generator_1.ports,
    Material={diffuse=RGB(221, 160, 221), emission=RGB(66, 48, 66), shine=0.5, specular=RGB(255, 255, 255), transparency=0})
spheres = CustomPreview(
    Geometry=joint_generator_1.spheres,
    Material={diffuse=RGB(221, 160, 221), emission=RGB(66, 48, 66), shine=0.5, specular=RGB(255, 255, 255), transparency=0})
